# Grasshopper definition 2015_04_09-iceray-anemone.ghx (Grasshopper 0.9.76)
# plug-ins: Anemone

number_slider = Slider(5, range=1..10)
srf = Surface(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)
loop_start = LoopStart(Repeat=number_slider, Trigger=[Toggle(False), number_slider], Data_0=srf)  # -> port, Counter, Data_0
lng = ListLength(List=flatten(loop_start.Data_0))
addition = Addition(A=loop_start.Counter, B=Slider(107, range=0..201))
random = Random(Range=Domain(0, 1), Number=lng, Seed=addition)  # -> graft(Random)
eval = Evaluate(F="If(x≤0.5, π/3., 0)", x=random)
area = Area(Geometry=loop_start.Data_0)  # -> Area, Centroid
pt = PointPolar(BasePlane=area.Centroid, XYAngle=eval, ZAngle=0, Offset=100)
ln = Line(StartPoint=area.Centroid, EndPoint=pt)
ext = ExtendCurve(Curve=ln, Type=0, Start=100, End=0)
srfsplit = SurfaceSplit(Surface=loop_start.Data_0, Curves=ext)  # -> graft(Fragments)
loop_end = LoopEnd(port=loop_start.port, Exit=False, Data_0=srfsplit, pausedState=False, state="Constant output")  # -> flatten(Data_0)
geodesic = Geodesic()
area_2 = Area(Geometry=loop_end)  # -> Area, Centroid
