# Grasshopper definition parametric_layers.gh (Grasshopper 0.9.76)

number_slider = Slider(1, range=0..10)
number_slider_2 = Slider(1, range=0..10)
number_slider_3 = Slider(5, range=0..10)
xz = XZPlane(Origin=Point(0, 0, 0))
eval = Evaluate(F="2*x", x=Slider(1, range=0..1))
number_slider_4 = Slider(100, range=0..100)
box = DomainBox(Base=PlaneXY(0, 0, 0), X=eval, Y=eval, Z=eval)
sph = Sphere(Base=PlaneXY(0, 0, 0), Radius=Slider(1.302, range=0..2))
recgrid = Rectangular(
    Plane=xz,
    SizeX=Slider(1, range=0..1),
    SizeY=Slider(1, range=0..1),
    ExtentX=Slider(1, range=0..10),
    ExtentY=Slider(5, range=0..10))  # -> Cells, flatten(Points)
xy = XYPlane(Origin=Point(0, 0, 0))
planesrf = PlaneSurface(Plane=recgrid.Points, XSize=Domain(-10, 10), YSize=Domain(-10, 10))
arrbox = BoxArray(Cell=box, XCount=number_slider_2, YCount=number_slider_2, ZCount=number_slider_3)  # -> Geometry, Transform
box_2 = CenterBox(Base=xy, X=1, Y=1, Z=1)
mesh_uv = MeshSurface(Surface=planesrf, UCount=number_slider_4, VCount=number_slider_4, Overhang=True, Equalize=False)
eval_2 = Evaluate(F="x-1", x=number_slider_3)
brep = Brep(arrbox.Geometry)
tri = Triangulate(Mesh=mesh_uv)  # -> Mesh, Count
mesh = Mesh(tri.Mesh)
sunion = SolidUnion(Breps=brep)  # disabled
multiplication = Multiplication(A=eval, B=eval_2)
box_3 = DomainBox(Base=PlaneXY(0, 0, 0), X=multiplication, Y=multiplication, Z=multiplication)  # disabled
smooth = SettingsQuality()
sdiff = SolidDifference(BrepsA=box_3, BrepsB=sunion)
trim = TrimSolid(Shape=box_3, Cutters=brep)
sdiff_2 = SolidDifference(BrepsA=sdiff, BrepsB=trim)
mesh_2 = MeshBrep(Brep=sdiff_2, Settings=smooth)
tri_2 = Triangulate(Mesh=mesh_2)  # -> Mesh, Count
demesh = DeconstructMesh(Mesh=mesh_2)  # -> Vertices, Faces, Colours, Normals
mesh_3 = Mesh(tri_2.Mesh)
