# Grasshopper definition parametric_pore.gh (Grasshopper 0.9.76)

number_slider = Slider(1, range=0..10)
number_slider_2 = Slider(1, range=0..10)
number_slider_3 = Slider(4, range=0..10)
eval = Evaluate(F="2*x", x=Slider(1, range=0..1))
sph = Sphere(Base=PlaneXY(0, 0, 0), Radius=Slider(1.05, range=0..2))
box = DomainBox(Base=PlaneXY(0, 0, 0), X=eval, Y=eval, Z=eval)
arrbox = BoxArray(Geometry=sph, Cell=box, XCount=number_slider_3, YCount=number_slider_3, ZCount=number_slider_3)  # -> Geometry, Transform
eval_2 = Evaluate(F="x-1", x=number_slider_3)
multiplication = Multiplication(A=eval, B=eval_2)
brep = Brep(arrbox.Geometry)
box_2 = DomainBox(Base=PlaneXY(0, 0, 0), X=multiplication, Y=multiplication, Z=multiplication)
sunion = SolidUnion(Breps=brep)
smooth = SettingsQuality()
sdiff = SolidDifference(BrepsA=box_2, BrepsB=sunion)
trim = TrimSolid(Shape=box_2, Cutters=brep)
sdiff_2 = SolidDifference(BrepsA=sdiff, BrepsB=trim)
mesh = MeshBrep(Brep=sdiff_2, Settings=smooth)
tri = Triangulate(Mesh=mesh)  # -> Mesh, Count
demesh = DeconstructMesh(Mesh=mesh)  # -> Vertices, Faces, Colours, Normals
mesh_2 = Mesh(tri.Mesh)
