# Grasshopper definition parametric_pore_ellipse_rework.gh (Grasshopper 0.9.76)

number_slider = Slider(1, range=0..10)
number_slider_2 = Slider(1, range=0..10)
number_slider_3 = Slider(2, range=0..2)
number_slider_4 = Slider(1.05, range=0..2)
panel = Panel("1.3")
number_slider_5 = Slider(4, range=0..10)
sph = Sphere(Base=PlaneXY(0, 0, 0), Radius=1)
multiplication = Multiplication(A=number_slider_3, B=number_slider_5)
scale_nu = ScaleNU(Geometry=sph, Plane=PlaneXY(0, 0, 0), ScaleX="1.4", ScaleY="1.39", ScaleZ="1.4")  # -> Geometry, Transform
box = DomainBox(Base=PlaneXY(0, 0, 0), X=number_slider_3, Y=number_slider_3, Z=number_slider_3)
arrbox = BoxArray(Geometry=scale_nu.Geometry, Cell=box, XCount=number_slider_5, YCount=number_slider_5, ZCount=number_slider_5)  # -> Geometry, Transform
eval = Evaluate(F="x-1", x=number_slider_5)
multiplication_2 = Multiplication(A=number_slider_3, B=eval)
multiplication_3 = Multiplication(A="1.4", B=eval)
multiplication_4 = Multiplication(A="1.4", B=eval)
brep = Brep(arrbox.Geometry)
box_2 = DomainBox(Base=PlaneXY(0, 0, 0), X=multiplication_2, Y=multiplication_2, Z=multiplication_2)
sunion = SolidUnion(Breps=brep)
smooth = SettingsQuality()
sdiff = SolidDifference(BrepsA=box_2, BrepsB=sunion)
trim = TrimSolid(Shape=box_2, Cutters=brep)
sdiff_2 = SolidDifference(BrepsA=sdiff, BrepsB=trim)
mesh = MeshBrep(Brep=sdiff_2, Settings=smooth)
tri = Triangulate(Mesh=mesh)  # -> Mesh, Count
demesh = DeconstructMesh(Mesh=mesh)  # -> Vertices, Faces, Colours, Normals
mesh_2 = Mesh(tri.Mesh)
