# Grasshopper definition parametric_tubes_jagged_profile.gh (Grasshopper 0.9.76)

number_slider = Slider(100, range=0..100)
eval = Evaluate(F="x/2", x=number_slider)
vec = VectorXYZ(XComponent=0, YComponent=number_slider, ZComponent=0)  # -> Vector, Length
xz = XZPlane(Origin=Point(0, 0, 0))
vec_2 = VectorXYZ(XComponent=0, YComponent=eval, ZComponent=0)  # -> Vector, Length
number_slider_2 = Slider(2, range=0..2)
number_slider_3 = Slider(8, range=0..10)
xz_2 = XZPlane(Origin=vec.Vector)
number_slider_4 = Slider(4, range=0..10)
xz_3 = XZPlane(Origin=vec_2.Vector)
sph = Sphere(Base=PlaneXY(0, 0, 0), Radius=1)
panel = Panel("1.0")
planesrf = PlaneSurface(Plane=xz, XSize=number_slider, YSize=number_slider)
planesrf_2 = PlaneSurface(Plane=xz_2, XSize=number_slider, YSize=number_slider)
planesrf_3 = PlaneSurface(Plane=xz_3, XSize=number_slider, YSize=number_slider)
pop2d = Populate2D(Region=planesrf, Count=100, Seed=1)
pop2d_2 = Populate2D(Region=planesrf_2, Count=100, Seed=1)
pop2d_3 = Populate2D(Region=planesrf_3, Count=100, Seed=1)
scale_nu = ScaleNU(Geometry=sph, Plane=PlaneXY(0, 0, 0), ScaleX="1.4", ScaleY="1.4", ScaleZ="1.4")  # -> Geometry, Transform
box = DomainBox(Base=PlaneXY(0, 0, 0), X=number_slider_2, Y=number_slider_2, Z=number_slider_2)
lng = ListLength(List=pop2d_3)
eval_2 = Evaluate(F="x-1", x=number_slider_3)
arrbox = BoxArray(Geometry=scale_nu.Geometry, Cell=box, XCount=number_slider_4, YCount=number_slider_4, ZCount=number_slider_3)  # -> Geometry, Transform
eval_3 = Evaluate(F="x-1", x=number_slider_4)
dom = ConstructDomain(DomainStart=Slider(0, range=0..1), DomainEnd=Slider(0, range=0..1))
dom_2 = ConstructDomain(DomainStart=Slider(0, range=0..1), DomainEnd=Slider(0.144, range=0..1))
multiplication = Multiplication(A=number_slider_2, B=eval_3)
multiplication_2 = Multiplication(A="1.4", B=eval_2)
random = Random(Range=dom_2, Number=lng, Seed=1)
random_2 = Random(Range=dom, Number=lng, Seed=1)
number_slider_5 = Slider(0, range=0..1)
brep = Brep(arrbox.Geometry)  # disabled
box_2 = DomainBox(Base=PlaneXY(0, 0, 0), X=multiplication, Y=multiplication, Z=multiplication_2)  # disabled
panel_2 = Panel(random_2)
sunion = SolidUnion(Breps=brep)
move = Move(Geometry=pop2d_3, Motion=Vector(0, 0, 1))  # -> Geometry, Transform
sdiff = SolidDifference(BrepsA=box_2, BrepsB=sunion)
vec_3 = VectorXYZ(XComponent=number_slider_5, YComponent=number_slider_5, ZComponent=random)  # -> Vector, Length
bbox = BoundingBox(Content=sdiff, Plane=PlaneXY(0, 0, 0))  # -> Box, Box_2
trim = TrimSolid(Shape=bbox.Box_2, Cutters=brep)
sdiff_2 = SolidDifference(BrepsA=sdiff, BrepsB=trim)
morph = BoxMorph(Geometry=sdiff_2, Reference=bbox.Box_2)
merge = Merge(Data1=graft(pop2d), Data2=graft(move.Geometry), Data3=graft(pop2d_2))
intcrv = Interpolate(Vertices=merge, Degree=3, Periodic=False, KnotStyle=1)  # -> Curve, Length, Domain
pipe = Pipe(Curve=intcrv.Curve, Radius=1, Caps=0)
smooth = SettingsQuality()
sunion_2 = SolidUnion(Breps=pipe)
mesh = MeshBrep(Brep=pipe, Settings=smooth)
tri = Triangulate(Mesh=mesh)  # -> Mesh, Count
mesh_2 = Mesh(tri.Mesh)
