# Grasshopper definition parametric_tubes_regular.gh (Grasshopper 0.9.76)

vec = VectorXYZ(XComponent=0, YComponent=0, ZComponent=Slider(100, range=0..100))  # -> Vector, Length
number_slider = Slider(10, range=0..100)
number_slider_2 = Slider(10, range=0..100)
xy = XYPlane(Origin=vec.Vector)
xy_2 = XYPlane(Origin=Point(0, 0, 0))
recgrid = Rectangular(Plane=xy_2, SizeX=number_slider, SizeY=number_slider, ExtentX=Slider(10, range=0..100), ExtentY=Slider(10, range=0..100))  # -> Cells, Points
recgrid_2 = Rectangular(
    Plane=xy,
    SizeX=number_slider_2,
    SizeY=number_slider_2,
    ExtentX=Slider(10, range=0..100),
    ExtentY=Slider(10, range=0..100))  # -> Cells, Points
merge = Merge(Data1=graft(recgrid.Points), Data2=graft(recgrid_2.Points))
intcrv = Interpolate(Vertices=merge, Degree=3, Periodic=False, KnotStyle=1)  # -> Curve, Length, Domain
pipe = Pipe(Curve=intcrv.Curve, Radius=1, Caps=0)
smooth = SettingsQuality()
custom_mesh_settings = SettingsCustom(
    StitchSeams=True,
    SimplePlanes=False,
    Refine=True,
    MinCount=3000,
    MaxCount=3500,
    AspectRatio=20,
    MaxDistance=0,
    MaxAngle=20,
    MinEdge=0,
    MaxEdge=0)
mesh = MeshBrep(Brep=pipe, Settings=custom_mesh_settings)
tri = Triangulate(Mesh=mesh)  # -> Mesh, Count
mesh_2 = Mesh(tri.Mesh)
